# Grasshopper definition pipeline.gh (Grasshopper 1.0.7)

boolean_toggle = BooleanToggle(True)
gene_pool = GenePool(Decimals=2, Maximum=1.2, Minimum=0, Value=[0.62, 0.46, 0.45, 0.21])
gene_pool_2 = GenePool(Decimals=2, Maximum=1.2, Minimum=0, Value=[0.75, 0.61, 0.51, 0.21])
gene_pool_3 = GenePool(Decimals=2, Maximum=1, Minimum=0, Value=[0, 0.3, 0.62, 1])
gene_pool_4 = GenePool(Decimals=2, Maximum=1.2, Minimum=0, Value=[0.78, 0.69, 0.51, 0.21])
gene_pool_5 = GenePool(Decimals=2, Maximum=1, Minimum=0, Value=[0, 0.1, 0.2, 0.3, 0.4, 0.5, 0.6, 0.7, 0.8, 0.9, 1])
gene_pool_6 = GenePool(Decimals=2, Maximum=2, Minimum=0, Value=[1.77, 1.5, 1.15, 1.42, 1.34, 1.31, 1.26, 1.03, 0.94, 0.6, 0.35])
position = Slider(0.61, range=0..1)
effect_region = Slider(0.2, range=0..0.2)
severity = Slider(0.68, range=0..1)
curve = Curve(reparameterize(<curve referenced from the Rhino model>))
curve_2 = Curve(reparameterize(<curve referenced from the Rhino model>))
curve_3 = Curve(reparameterize(<curve referenced from the Rhino model>))
curve_4 = Curve(reparameterize(<curve referenced from the Rhino model>))
curve_5 = Curve(reparameterize(<curve referenced from the Rhino model>))
stnosis_generator = GhPythonScript(position=position, effect_region=effect_region, percentage=severity)  # -> out, a
# ---------- stnosis_generator: Python ----------
__author__ = "gaozj"
__version__ = "2021.09.07"

import rhinoscriptsyntax as rs

def generate_stenosis(position, initial_radii, decay, severity):
    baseline_radii = [1.8, 1.6, 1.5, 1.45, 1.4, 1.35, 1.3, 1.25, 1.1, 0.9, 0.7, 0.5, 0.3]

for i, j in enumerate([1,2,3,4]):
    print(i,j)
# ---------- end stnosis_generator ----------
main_branch = Curve(reparameterize(<curve referenced from the Rhino model>))
sub_branch_blue = PipeVariable(Curve=curve, Parameters=gene_pool_3, Radii=gene_pool, Caps=boolean_toggle)
sub_branch_green = PipeVariable(Curve=curve_2, Parameters=gene_pool_3, Radii=gene_pool_4, Caps=boolean_toggle)
sub_branch_purple = PipeVariable(Curve=curve_3, Parameters=gene_pool_3, Radii=gene_pool_2, Caps=boolean_toggle)
sub_branch_yellow = PipeVariable(Curve=curve_4, Parameters=gene_pool_3, Radii=gene_pool_2, Caps=boolean_toggle)
sub_branch_light_blue = PipeVariable(Curve=curve_5, Parameters=gene_pool_3, Radii=gene_pool_4, Caps=boolean_toggle)
major_vessel = PipeVariable(Curve=main_branch, Parameters=gene_pool_5, Radii=gene_pool_6, Caps=boolean_toggle)
split_brep = SplitBrep(Brep=sub_branch_yellow, Cutter=major_vessel)
split_brep_2 = SplitBrep(Brep=sub_branch_light_blue, Cutter=major_vessel)
split_brep_3 = SplitBrep(Brep=sub_branch_purple, Cutter=major_vessel)
split_brep_4 = SplitBrep(Brep=sub_branch_green, Cutter=major_vessel)
split_brep_5 = SplitBrep(Brep=sub_branch_blue, Cutter=major_vessel)
dispatch = Dispatch(List=split_brep, DispatchPattern=[True, False])  # -> ListA, ListB
dispatch_2 = Dispatch(List=split_brep_2, DispatchPattern=[True, False])  # -> ListA, ListB
dispatch_3 = Dispatch(List=split_brep_3, DispatchPattern=[True, False])  # -> ListA, ListB
dispatch_4 = Dispatch(List=split_brep_4, DispatchPattern=[True, False])  # -> ListA, ListB
dispatch_5 = Dispatch(List=split_brep_5, DispatchPattern=[True, False])  # -> ListA, ListB
brep = Brep(dispatch_4.ListA)
brep_2 = Brep(dispatch.ListA)
brep_3 = Brep(dispatch_2.ListA)
brep_4 = Brep(dispatch_5.ListA)
brep_5 = Brep(dispatch_3.ListA)
mesh_brep = MeshBrep(
    Brep=major_vessel,
    Settings={GridMaxCount=0, GridMinCount=16, JaggedSeams=False, MaxEdgeLength=0, MinEdgeLength=0.0001, MinTolerance=0, Refine=True, RefineAngle=0, RelativeTolerance=0.65, SimplePlanes=True, Tolerance=0})
mesh_brep_2 = MeshBrep(
    Brep=brep_5,
    Settings={GridMaxCount=0, GridMinCount=16, JaggedSeams=False, MaxEdgeLength=0, MinEdgeLength=0.0001, MinTolerance=0, Refine=True, RefineAngle=0, RelativeTolerance=0.65, SimplePlanes=True, Tolerance=0})
mesh_brep_3 = MeshBrep(
    Brep=brep,
    Settings={GridMaxCount=0, GridMinCount=16, JaggedSeams=False, MaxEdgeLength=0, MinEdgeLength=0.0001, MinTolerance=0, Refine=True, RefineAngle=0, RelativeTolerance=0.65, SimplePlanes=True, Tolerance=0})
mesh_brep_4 = MeshBrep(
    Brep=brep_3,
    Settings={GridMaxCount=0, GridMinCount=16, JaggedSeams=False, MaxEdgeLength=0, MinEdgeLength=0.0001, MinTolerance=0, Refine=True, RefineAngle=0, RelativeTolerance=0.65, SimplePlanes=True, Tolerance=0})
mesh_brep_5 = MeshBrep(
    Brep=brep_2,
    Settings={GridMaxCount=0, GridMinCount=16, JaggedSeams=False, MaxEdgeLength=0, MinEdgeLength=0.0001, MinTolerance=0, Refine=True, RefineAngle=0, RelativeTolerance=0.65, SimplePlanes=True, Tolerance=0})
mesh_brep_6 = MeshBrep(
    Brep=brep_4,
    Settings={GridMaxCount=0, GridMinCount=16, JaggedSeams=False, MaxEdgeLength=0, MinEdgeLength=0.0001, MinTolerance=0, Refine=True, RefineAngle=0, RelativeTolerance=0.65, SimplePlanes=True, Tolerance=0})
custom_preview = CustomPreview(Geometry=mesh_brep_4, Material=ColourSwatch(SwatchColor=RGB(31, 214, 242)))
custom_preview_2 = CustomPreview(Geometry=mesh_brep_5, Material=ColourSwatch(SwatchColor=RGB(239, 242, 31)))
custom_preview_3 = CustomPreview(Geometry=mesh_brep_2, Material=ColourSwatch(SwatchColor=RGB(179, 31, 242)))
custom_preview_4 = CustomPreview(Geometry=mesh_brep_3, Material=ColourSwatch(SwatchColor=RGB(42, 250, 0)))
custom_preview_5 = CustomPreview(Geometry=mesh_brep_6, Material=ColourSwatch(SwatchColor=RGB(0, 46, 250)))
mesh_shadow = MeshShadow(Mesh=main_branch, Light=Vector(0, 0, -1), Plane=PlaneXY(0, 0, 0))
mesh_shadow_2 = MeshShadow(Mesh=mesh_brep, Light=Vector(0, 0, -1), Plane=PlaneXY(0, 0, 0))
construct_point = ConstructPoint(XCoordinate=0, YCoordinate=0, ZCoordinate=0)
plane_3pt = Plane3Pt()
gradient_hatch = GradientHatch(Boundaries=mesh_shadow_2, Colour1=RGB(255, 20, 147), Colour2=RGB(139, 0, 139))
